# Dynamo graph 180917_pyDynBundler.dyn (Dynamo 2.0.1.5055)

# group: variety of invalid python nodes in our case
python_script = Python()  # unwired: IN[0], IN[1]; starter script, not edited (OUT = 0)
boolean = BoolSelector(true)
python_script_2 = Python(IN[0]=boolean)  # unwired: IN[1]
# ---------- python_script_2.python (14 lines) ----------
#[PACKED]
# Enable Python support and load DesignScript library
import clr
clr.AddReference('ProtoGeometry')
from Autodesk.DesignScript.Geometry import *

# The inputs to this node will be stored as a list in the IN variables.
dataEnteringNode = IN

# Place your code below this line

# Assign your output to the OUT variable.
if IN[0]:
	OUT = 'hello world'
# ----------------------------------------
file_path = Filename("scripts\helloWorld.py")
python_script_3 = Python(IN[1]=file_path)  # unwired: IN[0]; same code as python_script_2

# group: All good, not enabled
boolean_2 = BoolSelector(false)
file_path_2 = Filename("X:\Not Backed Up Volatile Storage\cmalcolm\REVIT\_scripts\180523_add_occ_tags_up.dynamo.py")
python_script_4 = Python(IN[0]=boolean_2, IN[1]=file_path_2)  # starter script, not edited (OUT = 0)

# group: all good, packed, and enabled
boolean_3 = BoolSelector(true)
file_path_3 = Filename("scripts\helloWorld.py")
python_script_5 = Python(IN[0]=boolean_3, IN[1]=file_path_3)  # same code as python_script_2

# group: all good, but non existing path
boolean_4 = BoolSelector(true)
file_path_4 = Filename("..\..\..\..\..\Documents\directory_no_exists\path.py")
python_script_6 = Python(IN[0]=boolean_4, IN[1]=file_path_4)  # starter script, not edited (OUT = 0)
