# Dynamo graph 180917_pyDynBundler.dyn (Dynamo 2.0.1.5055)

boolean = BoolSelector(false)
file_path = Filename("X:\Not Backed Up Volatile Storage\cmalcolm\REVIT\_scripts\180523_add_occ_tags_up.dynamo.py")
python_script = Python(IN[0]=boolean, IN[1]=file_path)  # starter script, not edited (OUT = 0)
